# Grasshopper definition strings.gh (Grasshopper 1.0.7)

path = GetString("txt", AtLeast=1, AtMost=1)
python = GhPythonScript(x=path)  # -> out, a
# ---------- python: Python ----------
import os

path = os.path.dirname(ghdoc.Path) 
os.chdir(path)

if x:
    with open("damistring.txt", 'w') as f:
        f.write(x)
# ---------- end python ----------
context_print = ContextPrint(Text=path)
